# Grasshopper definition maisonnette.gh (Grasshopper 1.0.7)
# Copyright: Co-de-iT
# plug-ins: Assembler

# ----
# Handles
# piano descritto dalla polilinea
# Il componente Display Handle visualizza la normale come una linea nera puntinata. Utilizzatelo per verificate la direzione della normale
# referenziare qui le vostre Handles
crv = Curve(<curve referenced from the Rhino model>)
# parti editabili
# bake
# preview on/off
# nel disegnare le L polylines per le Handles la sequenza dei punti è fondamentale, e deve essere fatta in modo che la normale sia sempre USCENTE relativamente alla Collision Mesh
crv_2 = Curve(<curve referenced from the Rhino model>)
# normale al piano
# 2
# 0
# 1
crv_3 = Curve(<curve referenced from the Rhino model>)
# Handle che sembrano visivamente identiche potrebbero non esserlo: la normale potrebbe puntare all'interno della Collision Mesh.
# 
# In questi casi, potete usare il comando "Flip" in Rhino per invertire il verso della polilinea.
crv_4 = Curve(<curve referenced from the Rhino model>)
panel = Panel("""0
90""")
panel_2 = Panel("""0
90""")
panel_3 = Panel("""0
90""")
panel_4 = Panel("""0
90""")
handcon = ConstructHandle(Polyline=crv_2, RotationAngles=panel, Type=0, Weight=1)
handcon_2 = ConstructHandle(Polyline=crv_3, RotationAngles=panel_2, Type=0, Weight=1)
handcon_3 = ConstructHandle(Polyline=crv, RotationAngles=panel_3, Type=0, Weight=1)
handcon_4 = ConstructHandle(Polyline=crv_4, RotationAngles=panel_4, Type=0, Weight=1)
merge = Merge(Data1=handcon, Data2=handcon_2, Data3=handcon_3, Data4=handcon_4)

# ----
# Collision mesh (spazio occupato)
mesh = Mesh(<mesh referenced from the Rhino model>)

# ----
# RMB click > reference one geometry o reference multiple geometries
geo = Geometry()

# ----
# <title>
# 
# <description>
# 
# code by Alessio Erioli
# 
# v 0.1
# © a3 2021 / Creative Commons Attribution-Non Commercial-ShareAlike 4.0 International License
name = Panel("Object1")

# ----
# non modificare queste impostazioni (per ora)
volume = Volume(Geometry=mesh)  # -> Volume, Centroid
X = UnitX(Factor=1)

# ----
# referenziare qui le geometrie costruite (mesh)
mesh_2 = Mesh(<mesh referenced from the Rhino model>)
mesh_3 = Mesh(<mesh referenced from the Rhino model>)
mesh_4 = Mesh(<mesh referenced from the Rhino model>)

# ----
# Se le vostre geometrie non sono Mesh (ma, ad esempio, estrusioni o polisuperfici), referenziarle in un componente Geometry e poi attaccarlo ad un componente Mesh (come sopra).
# 
# Poi connettere l'output della Mesh al Merge.
mesh_5 = Mesh(geo)

xy = XYPlane(Origin=volume.Centroid)
merge_2 = Merge(Data1=mesh_2, Data2=mesh_3, Data3=mesh_4)

# ----
# AssemblyObject
aocon = ConstructAssemblyObject(Name=name, CollisionMesh=mesh, ReferencePlane=xy, Direction=X, Weight=1, Handles=merge, ZLockAO=False)

handdisp = DisplayHandles(Handles=merge, DisplaySize=Slider(0.355, range=0..1), absHTextSize=False)
mjoin = MeshJoin(Meshes=flatten(merge_2))

# ----
# Rules (Heuristics)
heuwri = HeuristicsWriter(AssemblyObjectsSet=aocon, noSH=False, noSO=False, xHT=False)
pt = Point(Point(0, 20, 0))
heud = HeuristicDisplay(
    OriginPoint=pt,
    AssemblyObjectsSet=aocon,
    HeuristicsSet=heuwri,
    XSize=1.2,
    YSize=1.2,
    NRows=Slider(4, range=2..10),
    DisplayType="AO Types",
    ZLockFilter=False,
    OutputType="AO Types")

reset = Button()
step = Button()
target_number = Panel("1000")

heuset = HeuristicsSettings(HeuristicsSet=heuwri, CurrentHeuristics=0, HeuristicsMode=0, ReceiverSelectionMode=0, SenderRuleSelectionMode=0)
pt_2 = Point(Point(-62.53285728, -28.21013159, 0))
aoaengine = AssemblerEngine(
    AssemblyObjectsSet=aocon,
    StartingPlane=pt_2,
    StartingObjectType=0,
    HeuristicsSettings=heuset,
    Go=False,
    Step=step,
    NIterations=Slider(10, range=10..100),
    TargetMaxNObjects=target_number,
    ResetSettings=False,
    Reset=reset,
    UseSupports=False,
    ZLockCheck=False)  # -> Assemblage, AssemblageCount
panel_5 = Panel(aoaengine.AssemblageCount)
aoadisp = DisplayAssemblage(Assemblage=aoaengine.Assemblage, ColorsOnly=False, OutputType="Objects")  # -> ColoredCollisionMeshes, Edges, Colors
aoadecon = DeconstructAssemblage(Assemblage=aoaengine.Assemblage)  # -> AssemblageObjects, AssemblageRules, ReceiverObjectsIndexes, AvailableObjectIndexes, UnreachableObjectIndexes
aoerplane = ExtractReferencePlane(AssemblyObject=aoadecon.AssemblageObjects)
orient = Orient(Geometry=mjoin, Source=xy, Target=aoerplane)  # -> Geometry, Transform

# ----
# Utilizzate questo componente per fare il bake su Rhino
mesh_6 = Mesh(orient.Geometry)

# ----
# edges (bordi) delle collision Meshes
medges = MeshEdges(Mesh=aoadisp.ColoredCollisionMeshes)  # -> NakedEdges, InteriorEdges, NonManifoldEdges
# edges (bordi) delle geometrie effettive
medges_2 = MeshEdges(Mesh=mesh_6)  # -> NakedEdges, InteriorEdges, NonManifoldEdges
# visualizzazione delle geometrie effettive
preview = CustomPreview(Geometry=mesh_6, Material=graft(aoadisp.Colors))
