# Grasshopper definition Animation path example.gh (Grasshopper 1.0.7)
# plug-ins: froGH

# ---- group: curva di percorso da Rhino (polilinea)
crv = Curve(<curve referenced from the Rhino model>)

# ----
# 2
# animare questo slider
# 
# right click > Animate
position_along_curve = Slider(0, range=0..1)

fillet = Fillet(Curve=crv, Radius=Slider(1.696, range=0..5))
eye_anticipation = Slider(0.071, range=0..0.1)
# <title>
# 
# <description>
# 
# code by Alessio Erioli
# 
# v 0.1
# © a3 2021 / Creative Commons Attribution-Non Commercial-ShareAlike 4.0 International License
crv_2 = Curve(reparameterize(fillet))
addition = Addition(A=position_along_curve, B=eye_anticipation)
eval = EvaluateCurve(Curve=crv_2, Parameter=addition)  # -> Point, Tangent, Angle
eval_2 = EvaluateCurve(Curve=crv_2, Parameter=position_along_curve)  # -> Point, Tangent, Angle
list = ValueList({"fixed point": 0, "along trajectory": 1}, selected="along trajectory")
pt = Point(Point(-42.84454371, 99.49514485, 62.54867461))

# ----
# attivare il controllo della telecamera
# 1
activate = BooleanToggle(False)

filter = StreamFilter(Gate=list, Stream0=pt, Stream1=eval.Point)
f_camcon = CameraControl(Location=eval_2.Point, Target=filter, Lens=Slider(21, range=21..120), UpVector=Vector(0, 0, 1), Activate=activate)
